# Grasshopper definition GH Workspace.gh (Grasshopper 1.0.8)

path_to_gui_py_here = Panel("U:\SHORTLIST\ICT Capstone Project\Capstone2-githubDuplicate2")

# ---- group: Process HabSim outputs into GH
processvars = Python3Script(modulePath=path_to_gui_py_here)  # -> report, outputFileAddress
# ---------- processvars: Python ----------
# Lines 2 - 8 are added to read external functions/modules
import sys
import os

# modulePath = r"U:\SHORTLIST\ICT Capstone Project\Capstone2-githubDuplicate"

if modulePath not in sys.path:
    sys.path.append(modulePath)

# Below is the execution code as in the main.py file with some adjustment
# Opening gui to perform user-defined variable transfer

from gui import VariableTransferGUI

print("Transferring HabSim parameters...")

def main():
    app = VariableTransferGUI()
    app.mainloop()

    destinationPath = app.destination.get().strip()
    return destinationPath

if __name__ == "__main__":
    app = VariableTransferGUI()
    outputFileAddress = main()

print(f"HabSim parameters transferred to {outputFileAddress}")
# ---------- end processvars ----------
panel = Panel(processvars.report)

# ---- group: Parse the transferred variables for simulation (.m)
# Translation of variables into visual geometry somewhere above
readtransferred = Python3Script(varLocation=processvars.outputFileAddress)  # -> report, parsedVar
# ---------- readtransferred: Python ----------
# MATLAB goes here!!

# Read in transferred variables
print("[Terminal output will appear here.]")

# Parse variables 
parsedVar = "[MATLAB outputs go here.]"
# ---------- end readtransferred ----------
currently_velocity_and_displacement_valu = Panel(readtransferred.parsedVar)  # "(Currently velocity and displacement values)"
panel_2 = Panel(readtransferred.report)

# ----
path_to_gh_output_file = Panel()

writeoutput = Python3Script(outputFileAddress=path_to_gh_output_file, variables=currently_velocity_and_displacement_valu)  # -> report
# ---------- writeoutput: Python ----------
"""Grasshopper Script"""
a = "[Terminal output will appear here.]"
print(a)
# ---------- end writeoutput ----------
panel_3 = Panel(writeoutput)
